# Grasshopper definition new_hops.gh (Grasshopper 1.0.7)
# plug-ins: Hops, Human

crv = Curve(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)
hops = Hops(
    Curves=crv,
    Count=Slider(28, range=0..100),
    CacheResultsInMemory=True,
    CacheSolveResults=True,
    RemoteDefinitionLocation="https://github.com/dav-leon/mpda22-session01/blob/main/03/test_hops.gh?raw=true",
    RemoteSolveVersion=(0, 1, 0),
    ShowInput_Enabled=False,
    ShowInput_Path=False,
    SynchronousSolve=True)
previewlw = CustomPreviewLineweights(Geometry=hops, Shader=ColourSwatch(SwatchColor=RGB(111, 188, 209)), Thickness=Slider(2, range=0..10), Absolute=False)
