# Grasshopper definition new_hops_adjusted.gh (Grasshopper 1.0.7)

crv = Curve(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)
curve = GetGeometry(crv, AtLeast=1, AtMost=1, DeleteInput=False, Filter=1074004029)
count = GetInteger(Slider(10, range=0..10), AtLeast=1, AtMost=1, Maximum=2147483647, Minimum=-2147483648)
divide = DivideCurve(Curve=curve, Count=count, Kinks=False)  # -> Points, Tangents, Parameters
rev = ReverseList(List=divide.Points)
subdivide = GetInteger(Slider(10, range=0..10), AtLeast=1, AtMost=1, Maximum=2147483647, Minimum=-2147483648)
ln = Line(StartPoint=divide.Points, EndPoint=rev)
divide_2 = DivideCurve(Curve=ln, Count=subdivide, Kinks=False)  # -> Points, Tangents, Parameters
context_bake = ContextBake(Geometry=ln)
context_bake_2 = ContextBake(Geometry=divide_2.Points)
